# Grasshopper definition AIA_ DATA VIS _ SHADOW TEST TWISTEDTOWER_V10HOPS.gh (Grasshopper 1.0.7)
# plug-ins: Anemone, LunchBox, Pufferfish, Human, Hops

# ---- group: Generate your random parameter state
number_of_samples = Slider(2000, range=0..10000)
seed = Slider(6, range=0..10)
python = GhPythonScript(x=number_of_samples, y=seed)  # -> out, triList; inputs x: Int32, y: Int32
# ---------- python: Python ----------
__author__ = "garo"
__version__ = "2021.04.26"

import Rhino.Geometry as rg
import random

triList = []
s= random.seed(y)



for j in range(x):
    sub = []
    
    #Height 01
    #sub.append(random.randint(10,100))
    #Height 02
    #sub.append(random.randint(10,80))
    #Grid Size
    #sub.append(random.randint(70,100))
    #Seed
    #sub.append(random.randint(10,80))
    #Month
    sub.append(random.randint(1,12))
    #Day
    sub.append(random.randint(1,21))
    #Rad1
    sub.append(random.randint(12,20))
    #Segments1
    sub.append(random.randint(3,5))
    #BHeight
    sub.append(random.randint(50,150))
    #Radius2
    sub.append(random.randint(8,16))
    #Segments2
    sub.append(random.randint(3,7))
    #Rotation Angle
    sub.append(random.randint(5,90))
    
    #point on Y axis
    #sub.append(rg.Point3d(0,random.uniform(0.1,1), 0))
    #random roatation
    #sub.append(random.randint(-90,90))
    
    #triangleSublist
    triList.append(sub)
# ---------- end python ----------
python_2 = GhPythonScript(x=python.triList)  # -> out, simplify(a)
# ---------- python_2: Python ----------
__author__ = "rossi"
__version__ = "2020.02.04"

import rhinoscriptsyntax as rs
a = x
# ---------- end python_2 ----------

# ----
number_slider = Slider(1500, range=0..2000)
loop_start = LoopStart(Repeat=number_slider, Trigger=Button(), Data="1")  # -> port, Counter, Data
panel = Panel(loop_start.Counter)
loop_end = LoopEnd(port=loop_start.port, Exit=False, Data=loop_start.Counter, TimeOutVal=0, pausedState=False, state="Constant output")
panel_2 = Panel(loop_end)

branch = TreeBranch(Tree=python_2.a, Path=Slider(234, range=0..1999), MaintainPaths=True)

item = ListItem(List=branch, Index=0, Wrap=True)  # -> Item, Item1, Item2, Item3, Item4, Item5
bwidth = Panel(item.Item3)
blength = Panel(item.Item4)
bheight = Panel(item.Item5)
day = Panel(item.Item)
month = Panel(item.Item1)
hour = Panel(item.Item2)

# ----
# Initial Grid
number_slider_2 = Slider(3, range=0..10)
sqgrid = Square(Plane=PlaneXY(0, 0, 0), Size=Slider(90, range=0..100), ExtentX=number_slider_2, ExtentY=number_slider_2)  # -> Cells, Points
viewer = ParamViewer(sqgrid.Cells)
path_mapper = PathMapper(sqgrid.Cells, source="{A;B;C}(i)", target="{A;B;C;i}")
viewer_2 = ParamViewer(path_mapper)
crv = Curve(path_mapper)
split = SplitTree(Data=crv, Masks=flatten("{0;0;1;1}"))  # -> Positive, Negative
number_slider_3 = Slider(8, range=0..10)
viewer_3 = ParamViewer(split.Positive)
viewer_4 = ParamViewer(split.Negative)
crv_2 = Curve(split.Negative)
neg = Negative(Value=number_slider_3)
neg_2 = Negative(Value=number_slider_3)
neg_3 = Negative(Value=Slider(20, range=0..20))
crv_3 = Curve(split.Positive)
offset = OffsetCurve(Curve=crv_2, Distance=neg, Plane=PlaneXY(0, 0, 0), Corners=1)
offset_2 = OffsetCurve(Curve=crv_3, Distance=neg_2, Plane=PlaneXY(0, 0, 0), Corners=1)
offset_3 = OffsetCurve(Curve=offset, Distance=neg_3, Plane=PlaneXY(0, 0, 0), Corners=1)

item_2 = ListItem(List=branch, Index=0, Wrap=True)  # -> Item, Item1, Item2, Item3, Item4, Item5, Item6, Item7

crv_4 = Curve(offset_3)
crv_5 = Curve(offset)
crv_6 = Curve(offset_2)

# ---- group: Plot
plot = Curve(crv_6)
srf = Surface(plot)

# ----
panel_4 = Panel(crv_4)
panel_5 = Panel(item_2.Item7)

explode = Explode(Curve=crv_5, Recursive=True)  # -> Segments, Vertices
explode_2 = Explode(Curve=crv_4, Recursive=True)  # -> Segments, Vertices
disc = Discontinuity(Curve=crv_4, Level=1)  # -> Points, Parameters
disc_2 = Discontinuity(Curve=crv_5, Level=1)  # -> Points, Parameters
divide = DivideCurve(Curve=explode_2.Segments, Count=Slider(1, range=1..10), Kinks=False)  # -> Points, Tangents, Parameters
rec_2pt = Rectangle2Pt(Plane=PlaneXY(0, 0, 0), PointA=disc.Points, PointB=disc_2.Points, Radius=0)  # -> simplify(Rectangle), Length
crv_cp = CurveClosestPoint(Point=divide.Points, Curve=graft(explode.Segments))  # -> Point, Parameter, Distance
boundary = BoundarySurfaces(Edges=rec_2pt.Rectangle)
ln = Line(StartPoint=crv_cp.Point, EndPoint=divide.Points)
srf_2 = Surface(boundary)
shift = ShiftList(List=ln, Shift=1, Wrap=False)
lng = ListLength(List=srf_2)
dom = ConstructDomain(DomainStart="10", DomainEnd="100")
edgesrf = EdgeSurface(CurveA=ln, CurveB=shift)  # -> simplify(Surface)
random = Random(Range=dom, Number=lng, Seed=graft(Slider(44, range=0..100)))
cull_i = CullIndex(List=reverse(edgesrf), Indices=0, Wrap=True)  # -> reverse(List)
Z = UnitZ(Factor=random)
trim = TrimTree(Tree=cull_i, Depth=2)
extr = Extrude(Base=srf_2, Direction=Z)

crv_7 = Curve(crv_6)
srf_3 = Surface(crv_7)

# ---- group: #floors
division = Division(A=item_2.Item4, B="3")
round = Round(Number=division)  # -> Nearest, Floor, Ceiling

# ---- group: EPW FILE
path = FilePath("D:\IAAC\03_TERM3\01_DATA VIS\02_WORKING FILES\01_GH\AUS_NSW.Sydney.947670_IWEC.epw")

# ----
# Twisted Tower
area = Area(Geometry=crv_7)  # -> Area, Centroid
Z_2 = UnitZ(Factor=item_2.Item4)
number_slider_4 = Slider(20, range=12..20)
number_slider_5 = Slider(16, range=8..16)
move = Move(Geometry=area.Centroid, Motion=Z_2)  # -> Geometry, Transform
polygon = Polygon(Plane=move.Geometry, Radius=item_2.Item5, Segments=item_2.Item6, FilletRadius=0)  # -> Polygon, Length
polygon_2 = Polygon(Plane=area.Centroid, Radius=item_2.Item2, Segments=item_2.Item3, FilletRadius=0)  # -> Polygon, Length
area_2 = Area(Geometry=polygon.Polygon)  # -> Area, Centroid
range = Range(Domain=Domain(0, 1), Steps=round.Nearest)
rotate = Rotate(Geometry=polygon.Polygon, Angle=degrees(item_2.Item7), Plane=area_2.Centroid)  # -> Geometry, Transform
twn2crvs = TweenTwoCurves(CurveA=polygon_2.Polygon, CurveB=rotate.Geometry, Factor=range, Refit=0, PointSample=0)
loft = Loft(Curves=twn2crvs, Options={Adjust=False, Closed=False, LoftEnds=0, LoftSimp=0, LoftType=0, Rebuild=10, Refit=0.01})
cap = CapHoles(Brep=loft)
brep = Brep(cap)

number_slider_6 = Slider(3, range=3..6)
number_slider_7 = Slider(3, range=3..5)

srf_4 = Surface(trim)
brep_2 = Brep(extr)

lng_2 = ListLength(List=srf_4)
dom_2 = ConstructDomain(DomainStart="10", DomainEnd="80")
ma = MassAddition(Input=lng_2)  # -> Result, PartialResults
random_2 = Random(Range=dom_2, Number=ma.Result, Seed=2)
Z_3 = UnitZ(Factor=random_2)
extr_2 = Extrude(Base=srf_4, Direction=Z_3)

# ---- group: Base Geometry
number_slider_8 = Slider(3, range=3..6)
number_slider_9 = Slider(14, range=12..20)

# ----
number_slider_10 = Slider(90, range=5..90)
b_height = Slider(150, range=50..150)

# ---- group: Top Geometry
number_slider_11 = Slider(3, range=3..5)
number_slider_12 = Slider(12, range=8..16)

# ----
area_3 = Area(Geometry=plot)  # -> Area, Centroid
Z_4 = UnitZ(Factor=b_height)
move_2 = Move(Geometry=area_3.Centroid, Motion=Z_4)  # -> Geometry, Transform
polygon_3 = Polygon(Plane=move_2.Geometry, Radius=number_slider_12, Segments=number_slider_11, FilletRadius=0)  # -> Polygon, Length
area_4 = Area(Geometry=polygon_3.Polygon)  # -> Area, Centroid
area_5 = Area(Geometry=polygon_3.Polygon)  # -> Area, Centroid
polygon_4 = Polygon(Plane=area_3.Centroid, Radius=number_slider_9, Segments=number_slider_8, FilletRadius=0)  # -> Polygon, Length
area_6 = Area(Geometry=polygon_4.Polygon)  # -> Area, Centroid
dist = Distance(PointA=area_6.Centroid, PointB=area_5.Centroid)
division_2 = Division(A=dist, B="3")
round_2 = Round(Number=division_2)  # -> Nearest, Floor, Ceiling
range_2 = Range(Domain=Domain(0, 1), Steps=round_2.Nearest)
rotate_2 = Rotate(Geometry=polygon_3.Polygon, Angle=degrees(number_slider_10), Plane=area_4.Centroid)  # -> Geometry, Transform
twn2crvs_2 = TweenTwoCurves(CurveA=polygon_4.Polygon, CurveB=rotate_2.Geometry, Factor=range_2, Refit=0, PointSample=0)
loft_2 = Loft(Curves=twn2crvs_2, Options={Adjust=False, Closed=False, LoftEnds=0, LoftSimp=0, LoftType=0, Rebuild=10, Refit=0.01})
cap_2 = CapHoles(Brep=loft_2)
brep_3 = Brep(cap_2)

previewlw = CustomPreviewLineweights(Geometry=[twn2crvs_2, plot], Shader=ColourSwatch(SwatchColor=RGB(212, 207, 207)), Thickness="1", Absolute=False)

# ---- group: Volume
volume = Volume(Geometry=brep_3)  # -> Volume, Centroid
roundd = RoundToDecimalPlace(NumberX=volume.Volume, DecimalPlace="0", RoundType=0)  # -> Rounded, Difference
bvolume = Panel(roundd.Rounded)

# ---- group: B Area
area_7 = Area(Geometry=twn2crvs_2)  # -> Area, Centroid
roundd_2 = RoundToDecimalPlace(NumberX=area_7.Area, DecimalPlace="0", RoundType=0)  # -> Rounded, Difference
ma_2 = MassAddition(Input=roundd_2.Rounded)  # -> Result, PartialResults
total_area = Panel(ma_2.Result)

# ---- group: Barea
area_8 = Area(Geometry=twn2crvs)  # -> Area, Centroid
roundd_3 = RoundToDecimalPlace(NumberX=area_8.Area, DecimalPlace="0", RoundType=0)  # -> Rounded, Difference
ma_3 = MassAddition(Input=roundd_3.Rounded)  # -> Result, PartialResults

# ----
number_slider_13 = Slider(100, range=0..100)
number_slider_14 = Slider(100, range=0..100)
number_slider_15 = Slider(100, range=0..100)
number_slider_16 = Slider(100, range=0..100)
number_slider_17 = Slider(52, range=0..100)

# ---- group: Building
brep_4 = Brep(brep_3)

# ---- group: Volume
num = Number(roundd.Rounded)

# ---- group: Bheigth
num_2 = Number(b_height)

# ----
total_area_2 = Number(ma_2.Result)

# ---- group: No of Floors
num_3 = Number(round_2.Nearest)

# ---- group: Rot Angle
num_4 = Number(number_slider_10)

# ----
previewlw_2 = CustomPreviewLineweights(Geometry=[twn2crvs, crv_7], Shader=ColourSwatch(SwatchColor=RGB(255, 255, 255)), Thickness="1", Absolute=False)
hops = Hops(
    Vol=num,
    TotalA=total_area_2,
    NoFl=num_3,
    Bhei=num_2,
    RotAng=num_4,
    CacheResultsInMemory=True,
    CacheSolveResults=True,
    RemoteDefinitionLocation="http://127.0.0.1:5000/sunTK",
    RemoteSolveVersion=(0, 1, 0),
    ShowInput_Enabled=False,
    ShowInput_Path=False,
    SynchronousSolve=True)
hops_2 = Hops(
    Vol=num,
    TotalA=total_area_2,
    NoFl=num_3,
    Bhei=num_2,
    RotAng=num_4,
    CacheResultsInMemory=False,
    CacheSolveResults=False,
    RemoteDefinitionLocation="http://127.0.0.1:5000/sunTKB",
    RemoteSolveVersion=(0, 1, 0),
    ShowInput_Enabled=False,
    ShowInput_Path=False,
    SynchronousSolve=True)
panel_6 = Panel(hops)

brep_5 = Brep(extr_2)
brep_6 = Brep(brep_2)
merge = Merge(Data1=brep_5, Data2=brep_6)

# ---- group: Overall Context
brep_7 = Brep(merge)

# ----
merge_2 = Merge(Data1=brep_7, Data2=brep_4)  # -> flatten(Result)

round_3 = Round(Number=hops_2)  # -> Nearest, Floor, Ceiling

analysisperiod = LBAnalysisPeriod(
    start_month=item_2.Item,
    start_day=item_2.Item1,
    start_hour=Slider(9, range=0..10),
    end_month=item_2.Item,
    end_day=item_2.Item1,
    end_hour=Slider(16, range=0..100))  # -> period, hoys, dates; plug-in component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
srf_5 = Surface(srf_3)

preview = CustomPreview(Geometry=merge, Material=ColourSwatch(SwatchColor=RGBA(66, 82, 87, 15)))
ml_prediction = Panel(round_3.Nearest)
round_4 = Round(Number=hops)  # -> Nearest, Floor, Ceiling

# ---- group: EPW FILE
path_2 = FilePath("D:\IAAC\03_TERM3\01_DATA VIS\02_WORKING FILES\01_GH\AUS_NSW.Sydney.947670_IWEC.epw")

# ----
model_1 = Panel(round_4.Nearest)
model_2 = Panel(round_3.Nearest)
X = UnitX(Factor=Slider(185, range=0..1000))
panel_7 = Panel(analysisperiod.hoys)

importepw = LBImportEPW(epw_file=path_2)  # -> location, dry_bulb_temperature, dew_point_temperature, relative_humidity, wind_speed, wind_direction, direct_normal_rad, diffuse_horizontal_rad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; plug-in component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
area_9 = Area(Geometry=crv_6)  # -> Area, Centroid
panel_8 = Panel(importepw.location)

# ----
# Select Sun Vectors
panel_9 = Panel("20")
sunpath = LBSunPath(
    location=importepw.location,
    hoys=analysisperiod.hoys,
    center_pt=area_9.Centroid,
    scale=Slider(2, range=0..10),
    data=importepw.dry_bulb_temperature,
    statement=panel_9)  # -> report, vectors, altitudes, azimuths, hoys, sun_pts, analemma, daily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; plug-in component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

# ---- group: Overall Context
brep_8 = Brep(merge)

# ----
# FACADE DIRECT SUN ACCESS
merge_3 = Merge(Data1=brep_8, Data2=brep)  # -> flatten(Result)
directsunhours = LBDirectSunHours(
    vectors=flatten(sunpath.vectors),
    geometry=flatten(srf_5),
    context=flatten(merge_3),
    grid_size=Slider(7, range=0..100),
    offset_dist=Slider(20, range=0..20),
    run=Toggle(True))  # -> report, points, results, mesh, legend, title, int_mtx; plug-in component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

crv_8 = Curve(<curve referenced from the Rhino model>)
number_slider_18 = Slider(10, range=0..10)
srf_6 = Surface(crv_8)
panel_10 = Panel(directsunhours.results)
mesh_uv = MeshSurface(Surface=srf_6, UCount=number_slider_18, VCount=number_slider_18, Overhang=True, Equalize=False)
recolormesh = Ladybug_RecolorMesh(analysisResult=panel_10, inputMesh=mesh_uv)  # -> readMe, newMesh, newLegend, legendBasePt, meshColors, legendColors; plug-in component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
lng_3 = ListLength(List=directsunhours.points)
labels = Panel("""hoys1
hoys2
hoys3
hoys4
hoys5
hoys6
hoys7
hoys8
Bvolume
BtotalArea
BNoFloors
Bheight
RotAngle""")
series = Series(Start=1, Step=1, Count=lng_3)
concat = Concatenate(FragmentA="f", FragmentB=series)
merge_4 = Merge(Data1=flatten(labels), Data2=flatten(concat))

num_5 = Number(item_2.Item7)
rotangle = Panel(num_5)

# ---- group: Bvolume
volume_2 = Volume(Geometry=brep)  # -> Volume, Centroid
roundd_4 = RoundToDecimalPlace(NumberX=volume_2.Volume, DecimalPlace="0", RoundType=0)  # -> Rounded, Difference
bvolume_2 = Panel(roundd_4.Rounded)

# ---- group: BtotalArea
data = Data(ma_3.Result)
btotalarea = Panel(data)

# ---- group: Nfloors
data_2 = Data(round.Nearest)
nfloors = Panel(data_2)

# ----
bheight_2 = Panel(item_2.Item4)

labels_2 = Panel(merge_4)
results = Panel(directsunhours.results)
entwine = Entwine(
    Branch00=analysisperiod.hoys,
    Branch01=bvolume_2,
    Branch02=btotalarea,
    Branch03=nfloors,
    Branch04=bheight_2,
    Branch05=rotangle,
    Branch06=results,
    FlattenInputs=True)  # -> flatten(Result)
merge_5 = Merge(Data1=sunpath.hoys, Data5=results)  # -> flatten(Result)
panel_12 = Panel(entwine)
join = TextJoin(Text=entwine, Join=" ")
join_2 = TextJoin(Text=merge_4, Join=" ")
rec = DataRecorder(join, DataLimit=-10, RecordData=True)
csv = CreateCSV(DataGridHeaders=flatten(join_2), ValueTree=flatten(rec), Delimiter=",")
panel_13 = Panel(csv)

# ---- group: compile dataset
panel_14 = Panel("D:\IAAC\03_TERM3\01_DATA VIS\02_WORKING FILES\02_CSV\xxx15.csv")  # disabled

# ---- group: writer
labels_3 = Panel("""hoys
facNorArea
facSouArea
facEasArea
facWesArea
shaNorArea
shaSouArea
shaEasArea
shaWesArea
srfPx1
srfPy1
srfPz1
srfPx2
srfPy2
srfPz2
srfPx3
srfPy3
srfPz3
srfPx4
srfPy4
srfPz4
srfPx5
srfPy5
srfPz5
srfPx6
srfPy6
srfPz6
srfPx7
srfPy7
srfPz7
srfPx8
srfPy8
srfPz8
srfPx9
srfPy9
srfPz9""")  # disabled
panel_15 = Panel(" ")  # disabled
panel_16 = Panel(" ")  # disabled
num_6 = Number(number_slider)  # disabled
join_3 = TextJoin(Join=panel_15)  # disabled
join_4 = TextJoin(Text=labels_3, Join=panel_16)  # disabled
toggle = BooleanToggle(True)  # disabled
num_7 = Number(num_6)  # disabled
export_robotmotion_3_r3_multi = PythonScript(toggle=toggle, path=panel_14, x=join_3, labs=join_4, y=num_7)  # disabled
# ---------- export_robotmotion_3_r3_multi: Python ----------
#script by Gabriella Rossi / CITA
import os
from os import listdir
from os.path import isfile, join
from scriptcontext import sticky as st

if True:
    #Create file
    filename = str(path)
    fil = open(filename, 'a+')
    
    if y < 1 :

        #write header and first line
        fil.write(labs)
        fil.write('\n' + x)
    else:
        #just write line
        fil.write('\n' + x)

    fil.close()
# ---------- end export_robotmotion_3_r3_multi ----------

# ---- group: writer / compile dataset
panel_17 = Panel("C:\Users\garo\Desktop\trianglesDataset.csv")  # disabled

# ----
# DIRECT SUN ACCESS
# SIMULATION
number_slider_19 = Slider(9, range=0..10)
analysisperiod_2 = LBAnalysisPeriod(
    start_month=item_2.Item,
    start_day=item_2.Item1,
    start_hour=number_slider_19,
    end_month=item_2.Item,
    end_day=item_2.Item1,
    end_hour=Slider(16, range=0..100))  # -> period, hoys, dates; plug-in component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
importepw_2 = LBImportEPW(epw_file=path)  # -> location, dry_bulb_temperature, dew_point_temperature, relative_humidity, wind_speed, wind_direction, direct_normal_rad, diffuse_horizontal_rad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; plug-in component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
area_10 = Area(Geometry=crv_6)  # -> Area, Centroid
panel_18 = Panel(importepw_2.location)
srf_7 = Surface(srf_3)

# ----
# Select Sun Vectors
panel_19 = Panel("20")
sunpath_2 = LBSunPath(
    location=importepw_2.location,
    hoys=analysisperiod_2.hoys,
    center_pt=area_10.Centroid,
    scale=Slider(2, range=0..10),
    data=importepw_2.dry_bulb_temperature,
    statement=panel_19)  # -> report, vectors, altitudes, azimuths, hoys, sun_pts, analemma, daily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; plug-in component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

directsunhours_2 = LBDirectSunHours(
    vectors=flatten(sunpath_2.vectors),
    geometry=flatten(srf_7),
    context=flatten(merge_2),
    grid_size=Slider(7, range=0..100),
    offset_dist=Slider(20, range=0..20),
    run=Toggle(True))  # -> report, points, results, mesh, legend, title, int_mtx; plug-in component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

lb_simulation = Panel(directsunhours_2.results)
move_3 = Move(Geometry=directsunhours_2.mesh, Motion=X)  # -> Geometry, Transform

number_slider_20 = Slider(15, range=0..25)
colrange = LBColorRange(index=number_slider_20)  # -> colors; plug-in component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
legendpar = LBLegendParameters(min=Slider(0, range=0..100), max=Slider(10, range=0..10), colors=colrange)  # -> leg_par; plug-in component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
heatmap = LBSpatialHeatmap(
    values=directsunhours_2.results,
    mesh=move_3.Geometry,
    legend_par=legendpar,
    legend_title="Hours",
    global_title="LB Simulation")  # -> mesh, legend, title, colors, legend_par; plug-in component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

# ----
# HOPS -
preview_2 = CustomPreview(
    Geometry=brep_3,
    Material={diffuse=RGB(221, 160, 221), emission=RGB(66, 48, 66), shine=0.5, specular=RGB(255, 255, 255), transparency=0})
panel_20 = Panel("http://127.0.0.1:5000/sunTC")
number_slider_21 = Slider(10, range=0..10)
srf_8 = Surface(srf)
colrange_2 = LBColorRange(index=number_slider_20)  # -> colors; plug-in component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
mesh_uv_2 = MeshSurface(Surface=srf_8, UCount=number_slider_21, VCount=number_slider_21, Overhang=True, Equalize=False)
legendpar_2 = LBLegendParameters(min=Slider(0, range=0..100), max=Slider(9, range=0..10), colors=colrange_2)  # -> leg_par; plug-in component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
heatmap_2 = LBSpatialHeatmap(values=ml_prediction, mesh=mesh_uv_2, legend_par=legendpar_2, legend_title="Hours", global_title="ML Prediction")  # -> mesh, legend, title, colors, legend_par; plug-in component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
