# Grasshopper definition AIA_ DATA VIS _ scenario_1.gh (Grasshopper 1.0.7)
# plug-ins: Anemone, LunchBox, Hops, Pufferfish

# ---- group: Generate your random parameter state
number_of_samples = Slider(2000, range=0..10000)
seed = Slider(6, range=0..10)
python = GhPythonScript(x=number_of_samples, y=seed)  # -> out, triList; inputs x: Int32, y: Int32
# ---------- python: Python ----------
__author__ = "garo"
__version__ = "2021.04.26"

import Rhino.Geometry as rg
import random

triList = []
s= random.seed(y)



for j in range(x):
    sub = []
    
    #Height 01
    #sub.append(random.randint(10,100))
    #Height 02
    #sub.append(random.randint(10,80))
    #Grid Size
    #sub.append(random.randint(70,100))
    #Seed
    #sub.append(random.randint(10,80))
    #Day
    sub.append(random.randint(1,30))
    #Month
    sub.append(random.randint(6,9))
    #Hour
    sub.append(random.randint(9,16))
    #Bwidth
    sub.append(random.randint(10,50))
    #Blength
    sub.append(random.randint(10,65))
    #Bheight
    sub.append(random.randint(10,150))
    
    #point on Y axis
    #sub.append(rg.Point3d(0,random.uniform(0.1,1), 0))
    #random roatation
    #sub.append(random.randint(-90,90))
    
    #triangleSublist
    triList.append(sub)
# ---------- end python ----------
python_2 = GhPythonScript(x=python.triList)  # -> out, simplify(a)
# ---------- python_2: Python ----------
__author__ = "rossi"
__version__ = "2020.02.04"

import rhinoscriptsyntax as rs
a = x
# ---------- end python_2 ----------

number_of_samples_2 = Slider(2000, range=0..10000)
seed_2 = Slider(6, range=0..10)
python_3 = GhPythonScript(x=number_of_samples_2, y=seed_2)  # -> out, triList; inputs x: Int32, y: Int32; same code as python
python_4 = GhPythonScript(x=python_3.triList)  # -> out, simplify(a); same code as python_2

# ----
number_slider = Slider(1330, range=0..1999)
branch = TreeBranch(Tree=python_2.a, Path=number_slider, MaintainPaths=True)

branch_2 = TreeBranch(Tree=python_4.a, Path=number_slider, MaintainPaths=True)
item = ListItem(List=branch, Index=0, Wrap=True)  # -> Item, Item1, Item2, Item3, Item4, Item5
item_2 = ListItem(List=branch_2, Index=0, Wrap=True)  # -> Item, Item1, Item2, Item3, Item4, Item5
bwidth = Panel(item.Item3)
blength = Panel(item.Item4)
bheight = Panel(item.Item5)
day = Panel(item.Item)
month = Panel(item.Item1)
hour = Panel(item.Item2)
day_2 = Panel(item_2.Item)
month_2 = Panel(item_2.Item1)
blength_2 = Panel(item_2.Item4)
bheight_2 = Panel(item_2.Item5)
bwidth_2 = Panel(item_2.Item3)

# ----
# Initial Grid
number_slider_2 = Slider(3, range=0..10)
sqgrid = Square(Plane=PlaneXY(0, 0, 0), Size=Slider(90, range=0..100), ExtentX=number_slider_2, ExtentY=number_slider_2)  # -> Cells, Points
viewer = ParamViewer(sqgrid.Cells)
path_mapper = PathMapper(sqgrid.Cells, source="{A;B;C}(i)", target="{A;B;C;i}")
viewer_2 = ParamViewer(path_mapper)
crv = Curve(path_mapper)
split = SplitTree(Data=crv, Masks=flatten("{0;0;1;1}"))  # -> Positive, Negative
number_slider_3 = Slider(8, range=0..10)
viewer_3 = ParamViewer(split.Positive)
viewer_4 = ParamViewer(split.Negative)
crv_2 = Curve(split.Negative)
neg = Negative(Value=number_slider_3)
neg_2 = Negative(Value=number_slider_3)
neg_3 = Negative(Value=Slider(20, range=0..20))
crv_3 = Curve(split.Positive)
offset = OffsetCurve(Curve=crv_2, Distance=neg, Plane=PlaneXY(0, 0, 0), Corners=1)
offset_2 = OffsetCurve(Curve=crv_3, Distance=neg_2, Plane=PlaneXY(0, 0, 0), Corners=1)
offset_3 = OffsetCurve(Curve=offset, Distance=neg_3, Plane=PlaneXY(0, 0, 0), Corners=1)

panel = Panel("http://127.0.0.1:5000/directSunE")
hoy = LBCalculateHOY(month=Slider(6, range=1..12), day=Slider(21, range=1..30), hour=Slider(12, range=9..16))  # -> hoy, doy, date; plug-in component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

crv_4 = Curve(offset_3)
crv_5 = Curve(offset)
crv_6 = Curve(offset_2)

panel_2 = Panel(crv_4)

num = Number(item.Item3)
num_2 = Number(item.Item4)
num_3 = Number(item.Item5)
blength_3 = Panel(num_2)
bheight_3 = Panel(num_3)
bwidth_3 = Panel(num)

crv_7 = Curve(crv_6)
explode = Explode(Curve=crv_7, Recursive=True)  # -> Segments, Vertices
item_3 = ListItem(List=explode.Segments, Index=0, Wrap=True)
offset_4 = OffsetCurve(Curve=crv_7, Distance=Slider(-4, range=-10..0), Plane=PlaneXY(0, 0, 0), Corners=1)
srf = Surface(crv_7)
end = EndPoints(Curve=item_3)  # -> Start, End
explode_2 = Explode(Curve=offset_4, Recursive=True)  # -> Segments, Vertices
end_2 = EndPoints(Curve=explode_2.Segments)  # -> Start, End
item_4 = ListItem(List=end_2.Start, Index=0, Wrap=True)
rectangle = Rectangle(Plane=item_4, XSize=num_2, YSize=num, Radius=0)  # -> Rectangle, Length
Z = UnitZ(Factor=num_3)
srf_2 = Surface(rectangle.Rectangle)
extr = Extrude(Base=srf_2, Direction=Z)

explode_3 = Explode(Curve=crv_5, Recursive=True)  # -> Segments, Vertices
explode_4 = Explode(Curve=crv_4, Recursive=True)  # -> Segments, Vertices
disc = Discontinuity(Curve=crv_4, Level=1)  # -> Points, Parameters
disc_2 = Discontinuity(Curve=crv_5, Level=1)  # -> Points, Parameters
divide = DivideCurve(Curve=explode_4.Segments, Count=Slider(1, range=1..10), Kinks=False)  # -> Points, Tangents, Parameters
rec_2pt = Rectangle2Pt(Plane=PlaneXY(0, 0, 0), PointA=disc.Points, PointB=disc_2.Points, Radius=0)  # -> simplify(Rectangle), Length
crv_cp = CurveClosestPoint(Point=divide.Points, Curve=graft(explode_3.Segments))  # -> Point, Parameter, Distance
boundary = BoundarySurfaces(Edges=rec_2pt.Rectangle)
ln = Line(StartPoint=crv_cp.Point, EndPoint=divide.Points)
srf_3 = Surface(boundary)
shift = ShiftList(List=ln, Shift=1, Wrap=False)
lng = ListLength(List=srf_3)
dom = ConstructDomain(DomainStart="10", DomainEnd="100")
edgesrf = EdgeSurface(CurveA=ln, CurveB=shift)  # -> simplify(Surface)
random = Random(Range=dom, Number=lng, Seed=graft(Slider(44, range=0..100)))
cull_i = CullIndex(List=reverse(edgesrf), Indices=0, Wrap=True)  # -> reverse(List)
Z_2 = UnitZ(Factor=random)
trim = TrimTree(Tree=cull_i, Depth=2)
extr_2 = Extrude(Base=srf_3, Direction=Z_2)

srf_4 = Surface(trim)
brep = Brep(extr_2)

lng_2 = ListLength(List=srf_4)
dom_2 = ConstructDomain(DomainStart="10", DomainEnd="80")
ma = MassAddition(Input=lng_2)  # -> Result, PartialResults
random_2 = Random(Range=dom_2, Number=ma.Result, Seed=2)
Z_3 = UnitZ(Factor=random_2)
extr_3 = Extrude(Base=srf_4, Direction=Z_3)

# ----
# LADYBUG PROCCESS
# Select Hours to Analyze
hoy_2 = LBCalculateHOY(month=item.Item1, day=item.Item, hour=item.Item2)  # -> hoy, doy, date; plug-in component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
number_slider_4 = Slider(13, range=9..16)
number_slider_5 = Slider(10, range=1..12)

brep_2 = Brep(extr_3)
brep_3 = Brep(brep)
merge = Merge(Data1=brep_2, Data2=brep_3)

# ---- group: Overall Context
brep_4 = Brep(merge)

# ----
preview = CustomPreview(Geometry=brep_4, Material=ColourSwatch(SwatchColor=RGBA(66, 82, 87, 208)))

analysisperiod = LBAnalysisPeriod(
    start_month=item_2.Item1,
    start_day=item_2.Item,
    start_hour=Slider(8, range=0..10),
    end_month=item_2.Item1,
    end_day=item_2.Item,
    end_hour=Slider(16, range=0..100))  # -> period, hoys, dates; plug-in component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
panel_3 = Panel(analysisperiod.hoys)
number_slider_6 = Slider(2, range=0..10)
number_slider_7 = Slider(7, range=0..100)
srf_5 = Surface(srf)
number_slider_8 = Slider(20, range=0..20)

day_of_the_year = Panel(hoy_2.doy)
date = Panel(hoy_2.date)
hour_of_the_year = Panel(hoy_2.hoy)

# ---- group: EPW FILE
path = FilePath("D:\Yara Gadah\Documents\IaaC_MCAD\AIA\S2-Vision\Week08_PreFinal\AUS_NSW.Sydney.947670_IWEC.epw")

# ----
importepw = LBImportEPW(epw_file=path)  # -> location, dry_bulb_temperature, dew_point_temperature, relative_humidity, wind_speed, wind_direction, direct_normal_rad, diffuse_horizontal_rad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; plug-in component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
area = Area(Geometry=crv_6)  # -> Area, Centroid
panel_4 = Panel(importepw.location)

# ----
# Select Sun Vectors
panel_5 = Panel("20")
sunpath = LBSunPath(
    location=importepw.location,
    hoys=hoy_2.hoy,
    center_pt=area.Centroid,
    scale=number_slider_6,
    data=importepw.dry_bulb_temperature,
    statement=panel_5)  # -> report, vectors, altitudes, azimuths, hoys, sun_pts, analemma, daily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; plug-in component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

sunpath_2 = LBSunPath(
    location=importepw.location,
    hoys=hoy.hoy,
    center_pt=area.Centroid,
    scale=number_slider_6,
    data=importepw.dry_bulb_temperature,
    statement=panel_5)  # -> report, vectors, altitudes, azimuths, hoys, sun_pts, analemma, daily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; plug-in component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

# ---- group: Overall Context
brep_5 = Brep(merge)

# ----
labels = Panel("""hoys
Bwidth
Blength
Bheight""")
round = Round(Number=num)  # -> Nearest, Floor, Ceiling
round_2 = Round(Number=num_2)  # -> Nearest, Floor, Ceiling
round_3 = Round(Number=num_3)  # -> Nearest, Floor, Ceiling

# ---- group: Hour of the Year
hoys = Panel(sunpath.hoys)

# ---- group: compile dataset
panel_6 = Panel("D:\IAAC\03_TERM3\01_DATA VIS\02_WORKING FILES\02_CSV\xxx15.csv")  # disabled

# ---- group: writer / compile dataset
panel_7 = Panel("C:\Users\garo\Desktop\trianglesDataset.csv")  # disabled

# ----
number_slider_9 = Slider(1500, range=0..2000)
loop_start = LoopStart(Repeat=number_slider_9, Trigger=Button(), Data="1")  # -> port, Counter, Data; disabled
panel_8 = Panel(loop_start.Counter)

# ---- group: Loop End
running = Running(port=loop_start.port, Exit=False, Data=loop_start.Counter, TimeOutVal=0, pausedState=False, state="Constant output")

# ----
panel_9 = Panel(running)

# ---- group: writer
labels_2 = Panel("""hoys
facNorArea
facSouArea
facEasArea
facWesArea
shaNorArea
shaSouArea
shaEasArea
shaWesArea
srfPx1
srfPy1
srfPz1
srfPx2
srfPy2
srfPz2
srfPx3
srfPy3
srfPz3
srfPx4
srfPy4
srfPz4
srfPx5
srfPy5
srfPz5
srfPx6
srfPy6
srfPz6
srfPx7
srfPy7
srfPz7
srfPx8
srfPy8
srfPz8
srfPx9
srfPy9
srfPz9""")  # disabled
panel_11 = Panel(" ")  # disabled
panel_12 = Panel(" ")  # disabled
num_4 = Number(number_slider_9)  # disabled
join = TextJoin(Join=panel_11)  # disabled
join_2 = TextJoin(Text=labels_2, Join=panel_12)  # disabled
toggle = BooleanToggle(True)  # disabled
num_5 = Number(num_4)  # disabled
export_robotmotion_3_r3_multi = PythonScript(toggle=toggle, path=panel_6, x=join, labs=join_2, y=num_5)  # disabled
# ---------- export_robotmotion_3_r3_multi: Python ----------
#script by Gabriella Rossi / CITA
import os
from os import listdir
from os.path import isfile, join
from scriptcontext import sticky as st

if True:
    #Create file
    filename = str(path)
    fil = open(filename, 'a+')
    
    if y < 1 :

        #write header and first line
        fil.write(labs)
        fil.write('\n' + x)
    else:
        #just write line
        fil.write('\n' + x)

    fil.close()
# ---------- end export_robotmotion_3_r3_multi ----------

# ----
# Hops
blength_5 = Slider(38, range=10..65)
bheight_5 = Slider(144, range=10..150)
bwidth_5 = Slider(28, range=10..50)

hops = Hops(
    H=bheight_5,
    W=bwidth_5,
    L=blength_5,
    S=hoy.hoy,
    CacheSolveResults=False,
    RemoteDefinitionLocation="http://127.0.0.1:5000/directSunE",
    RemoteSolveVersion=(0, 1, 0))
ml_prediction = Panel(hops)

num_6 = Number(bwidth_5)
num_7 = Number(blength_5)
num_8 = Number(bheight_5)
bheight_6 = Panel(num_8)
blength_6 = Panel(num_7)
bwidth_6 = Panel(num_6)

crv_8 = Curve(crv_6)
explode_5 = Explode(Curve=crv_8, Recursive=True)  # -> Segments, Vertices
item_5 = ListItem(List=explode_5.Segments, Index=0, Wrap=True)
offset_5 = OffsetCurve(Curve=crv_8, Distance=Slider(-4, range=-10..0), Plane=PlaneXY(0, 0, 0), Corners=1)
srf_6 = Surface(crv_8)
end_3 = EndPoints(Curve=item_5)  # -> Start, End
explode_6 = Explode(Curve=offset_5, Recursive=True)  # -> Segments, Vertices
end_4 = EndPoints(Curve=explode_6.Segments)  # -> Start, End
item_6 = ListItem(List=end_4.Start, Index=0, Wrap=True)
rectangle_2 = Rectangle(Plane=item_6, XSize=num_7, YSize=num_6, Radius=0)  # -> Rectangle, Length
Z_4 = UnitZ(Factor=num_8)
srf_7 = Surface(rectangle_2.Rectangle)
extr_4 = Extrude(Base=srf_7, Direction=Z_4)

round_4 = Round(Number=ml_prediction)  # -> Nearest, Floor, Ceiling
round_to_decimal_place = RoundToDecimalPlace(NumberX=ml_prediction, DecimalPlace="00.00", RoundType=Slider(2, range=0..2))  # -> Rounded, Difference
cull_index = CullIndex(List=round_to_decimal_place.Rounded, Indices="00.00", Wrap=True)
ml_prediction_2 = Panel(cull_index)

brep_6 = Brep(extr_4)

# ----
# LADYBUG SIMULATION RESULTS
number_slider_10 = Slider(20, range=0..20)
merge_2 = Merge(Data1=brep_4, Data2=brep_6)
srf_8 = Surface(srf)
number_slider_11 = Slider(15, range=0..100)
directsunhours = LBDirectSunHours(
    vectors=flatten(sunpath.vectors),
    geometry=flatten(srf_8),
    context=flatten(merge_2),
    grid_size="7",
    offset_dist=number_slider_10,
    run=Toggle(True))  # -> report, points, results, mesh, legend, title, int_mtx; plug-in component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
colrange = LBColorRange(index=number_slider_11)  # -> colors; plug-in component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
legendpar = LBLegendParameters(min=Slider(0, range=0..100), max=Slider(10, range=0..10), colors=colrange)  # -> leg_par; plug-in component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
X = UnitX(Factor=Slider(185, range=0..1000))
move = Move(Geometry=directsunhours.mesh, Motion=X)  # -> Geometry, Transform

colrange_2 = LBColorRange(index=number_slider_11)  # -> colors; plug-in component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
legendpar_2 = LBLegendParameters(min=Slider(0, range=0..100), max=Slider(10, range=0..10), colors=colrange_2)  # -> leg_par; plug-in component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

srf_9 = Surface(srf)
number_slider_12 = Slider(10, range=0..10)
mesh_surface = MeshSurface(Surface=srf_9, UCount=number_slider_12, VCount=number_slider_12, Overhang=True, Equalize=False)
heatmap = LBSpatialHeatmap(values=cull_index, mesh=mesh_surface, legend_par=legendpar_2, legend_title="Hours", global_title="ML Prediction")  # -> mesh, legend, title, colors, legend_par; plug-in component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

# ----
# FACADE DIRECT SUN ACCESS
merge_3 = Merge(Data1=brep_6, Data2=extr)
toggle_2 = BooleanToggle(True)
directsunhours_2 = LBDirectSunHours(
    vectors=flatten(sunpath.vectors),
    geometry=flatten(srf_5),
    context=flatten(merge_3),
    grid_size=number_slider_7,
    offset_dist=number_slider_8,
    run=toggle_2)  # -> report, points, results, mesh, legend, title, int_mtx; plug-in component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

directsunhours_3 = LBDirectSunHours(
    vectors=flatten(sunpath_2.vectors),
    geometry=flatten(srf_5),
    context=flatten(merge_3),
    grid_size=number_slider_7,
    offset_dist=number_slider_8,
    run=toggle_2)  # -> report, points, results, mesh, legend, title, int_mtx; plug-in component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
heatmap_2 = LBSpatialHeatmap(
    values=directsunhours_3.results,
    mesh=move.Geometry,
    legend_par=legendpar,
    legend_title="Hours",
    global_title="LB Simulation")  # -> mesh, legend, title, colors, legend_par; plug-in component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
lb_simulation = Panel(directsunhours_3.results)
panel_13 = Panel(directsunhours_2.results)
lng_3 = ListLength(List=directsunhours_2.points)
series = Series(Start=1, Step=1, Count=lng_3)
concat = Concatenate(FragmentA="f", FragmentB=series)
merge_4 = Merge(Data1=flatten(labels), Data2=flatten(concat))
results = Panel(directsunhours_2.results)
labels_3 = Panel(merge_4)
entwine = Entwine(
    Branch00=sunpath.hoys,
    Branch01=round.Nearest,
    Branch02=round_2.Nearest,
    Branch03=round_3.Nearest,
    Branch04=results,
    FlattenInputs=True)  # -> flatten(Result)
merge_5 = Merge(Data1=sunpath.hoys, Data2=round.Nearest, Data3=round_2.Nearest, Data4=round_3.Nearest, Data5=results)  # -> flatten(Result)
panel_14 = Panel(entwine)
join_3 = TextJoin(Text=entwine, Join=" ")
join_4 = TextJoin(Text=merge_4, Join=" ")
rec = DataRecorder(join_3, DataLimit=-10, RecordData=True)
csv = CreateCSV(DataGridHeaders=flatten(join_4), ValueTree=flatten(rec), Delimiter=",")
panel_15 = Panel(csv)
